# Grasshopper definition MODELGH.gh (Grasshopper 1.0.7)
# plug-ins: Kangaroo2 Components

xy_plane = XYPlane(Origin=Point(0, 0, 0))
circle = Circle(Plane=xy_plane, Radius=Slider(174, range=0..200))
division = Division(A=Slider(500, range=0..500), B=Slider(8.9, range=0..10))
division_2 = Division(A=Slider(454, range=0..500), B=Slider(7.3, range=0..10))
construct_domain = ConstructDomain(DomainStart=division_2, DomainEnd=division)
area = Area(Geometry=circle)  # -> Area, Centroid
range = Range(Domain=construct_domain, Steps=Slider(4, range=0..10))
circle_2 = Circle(Plane=area.Centroid, Radius=range)
length = Length(Curve=circle_2)
division_3 = Division(A=length, B=Slider(2, range=0..10))
divide_curve = DivideCurve(Curve=circle_2, Count=division_3, Kinks=circle)  # -> simplify(Points), Tangents, Parameters
polyline = PolyLine(Vertices=divide_curve.Points, Closed=invert(False))
explode = Explode(Curve=polyline, Recursive=True)  # -> Segments, Vertices
shift_list = ShiftList(List=explode.Segments, Shift=1, Wrap=True)
list_length = ListLength(List=divide_curve.Points)
point = Point(flatten(divide_curve.Points))
line = Line(flatten(explode.Segments))
series = Series(Start=0, Step=1, Count=list_length)
entwine = Entwine(Branch00=line, Branch01=point, FlattenInputs=True)
angle = Angle(LineA=explode.Segments, LineB=shift_list, RestAngle="0", Strength=Slider(1000, range=0..1000))
shift_list_2 = ShiftList(List=series, Shift=1, Wrap=True)
length_line = LengthLine(Line=flatten(explode.Segments), Length=Slider(8, range=0..20), Strength=Slider(10, range=0..10))
onmesh = OnMesh(Points=divide_curve.Points, Mesh=circle, Strength=Slider(1000, range=0..1000))
integer = Integer(flatten(shift_list_2))
integer_2 = Integer(flatten(series))
show = Show(G=polyline)
collider = Collider(Objects=entwine, Radii=Slider(1.5, range=0..5), IgnoreA=integer_2, IgnoreB=integer, Strength=Slider(1000, range=0..1000))
entwine_2 = Entwine(Branch00=show, Branch01=[onmesh, length_line, collider, angle], FlattenInputs=True)
solver = Solver(GoalObjects=entwine_2, Reset=Button(), Threshold=1e-15, Tolerance=0.0001, On=Toggle(False))  # -> I, V, simplify(O)
explode_tree = ExplodeTree(Data=solver.O)  # -> Branch0, Branch1
curve = Curve(explode_tree.Branch0)
discontinuity = Discontinuity(Curve=curve, Level=1)  # -> Points, Parameters
nurbs_curve = NurbsCurve(Vertices=discontinuity.Points, Degree=3, Periodic=False)  # -> Curve, Length, Domain
number_slider = Slider(6, range=0..10)
offset_curve = OffsetCurve(Curve=circle, Distance=Slider(5, range=0..10), Corners=1)
